# Grasshopper definition Pos_Tag_Empty_Space.gh (Grasshopper 1.0.8)
# plug-ins: Pufferfish, Rhino.Inside for Autodesk Revit

doubleclick = BooleanToggle(False)
dss_annotation_panel = Panel("Help on WhiteWork")
# Segment
# group modules into larger coherent parts
# User Interface: I/O
dss_log_v5_2 = PythonScript(Help=doubleclick)  # inputs Help: Boolean
# ---------- dss_log_v5_2: Python ----------
"""
Set grasshopper template and provide easy acces to Help file in intranet

"""

"""
Credits:
    20211117
    Created by Vladimir Ondejcik
    White arkitekter AB

Based on:
    WOMBAT version <0.0.1>
    Script by <Brian Ringley>
        def libraries() by <Giulio Piacentino> see <http://www.grasshopper3d.com/forum/topics/gh-filename-is-python>
        def writeToFile() by <Data Analytics Society> see <https://www.youtube.com/watch?v=-TF3mXhnCDw>
    Script version <15 September 2015> 
    Copyright <Creative Commons Sharealike>
"""


#add dsearch default path located on cad.local
import sys
new_path = r"\\sesthfs02\DSEARCH\REPOSITORY\Grasshopper\Xtras\DsearchCode"
if new_path not in sys.path: sys.path.append(new_path)

#import dsearch plugin
import dsearch as ds

import os

print sys.path

#reload module (this has use when working on module)
#reload(ds.DS_Log)
#reload(ds.DS_Links)

#setup template
template=ds.DS_Links.Template
ds.DS_Log.DS_Template(template)

#run help from module 
if Help:
    helpLink=ds.DS_Links.HelpLink
    ds.DS_Log.DS_Help(helpLink)

    #turn toggle back to false
    obj=ghenv.Component.Params.Input[0].Sources[0]
    obj.Value=False
    obj.ExpireSolution(True)
# ---------- end dss_log_v5_2 ----------

dss_projectnumber = Panel("0000")
dss_projectname = Panel("name")

# ----
# Organization of Grasshopper scripts at White:
# Script should be created and annotated always with notion that other person will need to use/edit them.
# Build your script in modules and segments, use color coding and annotation according this template.
# This standard should be applied to all scripts, big or small.
# 
# Read  guide on white work:
# "https://work.white.se/grasshopper-developer-guide/"
# For Advanced users:
# For design scripts running more than a month use "dsInitialize" and "dsScriptLog" functions on Dsearch tab to log changes over time.
dss_annotation_panel_2 = Panel("""Tip of a day:
You can change default colour grups by right clicking
Graphical templates are located on "Dsearch" tab""")
# GRAPHIC
# STANDARD
# In
# data and geometry import from rhino or external platforms
image = ImageSampler(dss_annotation_panel_2, Filter="Colour", Interpolate=False, Umax=1, Umin=0, Vmax=1, Vmin=0, Wrap=0)

active_selection = GraphicalElement()

# ---- group: Only tags
query_categories = QueryCategories(Type=2, IsVisibleUI=True, IsSubcategory=False)
match_text = MatchText(Text=query_categories, RegEx="Tags", Case=True)
match_text_2 = MatchText(Text=query_categories, RegEx="Room Tags", Case=True)
cull_pattern = CullPattern(List=query_categories, CullPattern=match_text)
category_filter = CategoryFilter(Categories=cull_pattern, Inverted=False)
filter_elements = FilterElements(Elements=active_selection, Filter=category_filter)
cull_pattern_2 = CullPattern(List=active_selection, CullPattern=filter_elements)

# ----
# Control
# General
# Monitor
# Out
# variable parameters and script execution
# (sliders, boolean togggle, text input,...)
# monitor data and geometry preview (used for panels for example)
# output data to rhino or external platforms
# WIP
# Annotation
# Plugin
# general annotation and notes
# textbased scripting and special plugins
# f.ex: HumanUI, kangaroo,...
# problematic or under repair or construction
dss_annotation_panel_3 = Panel("general development modules")

panel = Panel("""Floors
Site
Rooms
Walls""")
query_categories_2 = QueryCategories(Discipline=1, Type=2, IsVisibleUI=True, IsSubcategory=False)
query_categories_3 = QueryCategories(Type=2, Name="Grids", IsVisibleUI=True, IsSubcategory=False)  # -> flatten(Categories)
query_categories_4 = QueryCategories(Type=1, Name=panel, IsVisibleUI=True, IsSubcategory=False)  # -> flatten(Categories)
query_categories_5 = QueryCategories(Type=1, Name="Doors", IsVisibleUI=True, IsSubcategory=False)  # -> flatten(Categories)
match_text_3 = MatchText(Text=query_categories_2, RegEx="Tag", Case=True)
query_categories_6 = QueryCategories(Type=1, Name="Walls", IsVisibleUI=True, IsSubcategory=False)  # -> flatten(Categories)
cull_pattern_3 = CullPattern(List=query_categories_2, CullPattern=match_text_3)
category_filter_2 = CategoryFilter(Categories=query_categories_6, Inverted=False)
unit_z = UnitZ(Factor=Slider(6932, range=0..10000))
category_filter_3 = CategoryFilter(Categories=query_categories_5, Inverted=False)
query_elements = QueryElements(Filter=category_filter_3)  # -> Elements, Count
category_filter_4 = CategoryFilter(Categories=query_categories_3, Inverted=False)
query_elements_2 = QueryElements(Filter=category_filter_4)  # -> Elements, Count
number_slider = Slider(1000, range=0..1000)
power_of_10 = PowerOf10(Value=Slider(6, range=0..10))

# ---- group: Query elements in view
list_item = ListItem(List=cull_pattern_2, Index=0, Wrap=True)
element_type = ElementType(Element=list_item)  # -> Element, Type
# Back-end
active_view = ActiveView()

# ----
element_category = ElementCategory(Element=list_item)  # -> Element, Category
category_filter_5 = CategoryFilter(Categories=element_category.Category, Inverted=False)
annotation_references = AnnotationReferences(Annotation=simplify(element_category.Element))  # -> simplify(References)

# ---- group: Query elements in view (continued)
query_view_elements = QueryViewElements(View=active_view, Categories=cull_pattern, Filter=category_filter_5)

# ----
element_category_2 = ElementCategory(Element=annotation_references)  # -> Element, Category
set_difference = SetDifference(SetA=cull_pattern_3, SetB=element_category.Category)

# ---- group: Check for room tags
cull_pattern_4 = CullPattern(List=query_categories, CullPattern=match_text_2)
category_filter_6 = CategoryFilter(Categories=cull_pattern_4, Inverted=False)
filter_elements_2 = FilterElements(Elements=query_view_elements, Filter=category_filter_6)
cull_pattern_5 = CullPattern(List=query_view_elements, CullPattern=filter_elements_2)

# ----
category = Category(set_difference)
category_filter_7 = CategoryFilter(Categories=flatten(category), Inverted=False)
category_filter_8 = CategoryFilter(Categories=flatten([cull_pattern_4, query_categories_4, query_categories_3, element_category_2.Category]), Inverted=True)
view = View(active_view)
level = Level(view)
plane = Plane(level)
visible_in_view_filter = VisibleInViewFilter(View=view, Inverted=False)
logical_and_filter = LogicalAndFilter(FilterA=visible_in_view_filter, FilterB=category_filter_2)
logical_and_filter_2 = LogicalAndFilter(FilterA=visible_in_view_filter, FilterB=category_filter_7)
logical_and_filter_3 = LogicalAndFilter(FilterA=visible_in_view_filter, FilterB=category_filter_8)
query_elements_3 = QueryElements(Filter=logical_and_filter)  # -> Elements, Count
bounding_rectangle = BoundingRectangle(Geometry=query_elements_3.Elements, Plane=plane, Axis=0, Slide=0, Union=True)  # -> Bounding, DimensionX, DimensionY
project = Project(Geometry=bounding_rectangle.Bounding, Plane=plane)  # -> Geometry, Transform
extrude = Extrude(Base=project.Geometry, Direction=unit_z)
view_2 = View(active_view)
cull_pattern_6 = CullPattern(List=query_view_elements, CullPattern=invert(filter_elements_2))
query_elements_4 = QueryElements(Filter=logical_and_filter_3)  # -> Elements, Count
query_view_elements_2 = QueryViewElements(View=view_2, Categories=category, Filter=logical_and_filter_2)
cap_holes = CapHoles(Brep=extrude)
volume = Volume(Geometry=cap_holes)  # -> Volume, Centroid
match_text_4 = MatchText(Text=query_view_elements_2, RegEx="Tag", Case=True)
scale = Scale(Geometry=cap_holes, Center=volume.Centroid, Factor=Slider(1.2, range=0..10))  # -> Geometry, Transform
graphical_element = GraphicalElement(query_elements_4.Elements)
bounding_box_filter = BoundingBoxFilter(BoundingBox=scale.Geometry, Union=True, Strict=True, Tolerance=0, Inverted=False)  # -> Filter, Target

annotation_references_2 = AnnotationReferences(Annotation=simplify(cull_pattern_5))  # -> simplify(References)
room = Room(annotation_references_2)
spatial_element_boundary = SpatialElementBoundary(SpatialElement=room, BoundaryLocation=0)  # -> simplify(Boundary)

element_view_geometry = ElementViewGeometry(Elements=query_elements.Elements, View=view)  # -> flatten(Elements), Geometry, Categories
cull_pattern_7 = CullPattern(List=query_view_elements_2, CullPattern=match_text_4)
null_item = NullItem(Item=graphical_element)  # -> NullFlags, InvalidFlags, Description
cull_pattern_8 = CullPattern(List=query_elements_4.Elements, CullPattern=invert(null_item.NullFlags))
filter_elements_3 = FilterElements(Elements=query_elements_4.Elements, Filter=bounding_box_filter.Filter)
curve = Curve(element_view_geometry.Geometry)
cull_pattern_9 = CullPattern(List=query_elements_4.Elements, CullPattern=filter_elements_3)
null_item_2 = NullItem(Item=curve)  # -> NullFlags, InvalidFlags, Description
element_view_geometry_2 = ElementViewGeometry(Elements=cull_pattern_9, View=view)  # -> Elements, simplify(Geometry), Categories
cull_pattern_10 = CullPattern(List=curve, CullPattern=invert(null_item_2.NullFlags))
list_length = ListLength(List=cull_pattern_5)
list_length_2 = ListLength(List=cull_pattern_5)
bounding_rectangle_2 = BoundingRectangle(Geometry=element_view_geometry.Geometry, Plane=PlaneXY(0, 0, 0), Axis=0, Slide=0, Union=True)  # -> simplify(Bounding), DimensionX, DimensionY
line = Line(element_view_geometry_2.Geometry)
curve_2 = Curve(element_view_geometry_2.Geometry)
brep = Brep(flatten(element_view_geometry_2.Geometry))
bounding_rectangle_3 = BoundingRectangle(Geometry=simplify(graft(cull_pattern_7)), Plane=PlaneXY(0, 0, 0), Axis=0, Slide=0, Union=True)  # -> simplify(Bounding), DimensionX, DimensionY
view_3 = View(active_view)
addition = Addition(A=list_length_2, B="0")
null_item_3 = NullItem(Item=curve_2)  # -> NullFlags, InvalidFlags, Description
plane_2 = Plane(view_3)
null_item_4 = NullItem(Item=brep)  # -> NullFlags, InvalidFlags, Description
boolean = Boolean(addition)
cull_pattern_11 = CullPattern(List=curve_2, CullPattern=invert(null_item_3.NullFlags))
stream_filter = StreamFilter(Gate=boolean, Stream1=spatial_element_boundary)
cull_pattern_12 = CullPattern(List=brep, CullPattern=invert(null_item_4.NullFlags))
list_length_3 = ListLength(List=cull_pattern_6)

mesh_brep = MeshBrep(
    Brep=cull_pattern_12,
    Settings={GridMaxCount=0, GridMinCount=16, JaggedSeams=False, MaxEdgeLength=0, MinEdgeLength=0.0001, MinTolerance=0, Refine=True, RefineAngle=0, RelativeTolerance=0.65, SimplePlanes=True, Tolerance=0})
bounding_rectangle_4 = BoundingRectangle(Geometry=simplify(graft(cull_pattern_12)), Plane=plane_2, Axis=0, Slide=0, Union=True)  # -> Bounding, DimensionX, DimensionY
deconstruct_mesh = DeconstructMesh(Mesh=mesh_brep)  # -> simplify(Vertices), Faces, Colours, Normals
c_script = CSharpScript(lst_points=deconstruct_mesh.Vertices, random=Toggle(True))  # -> out, sphere, center, radius, boundary_points, center2, radius2; inputs lst_points: list of Point3d, random: Boolean
# ---------- c_script: C# ----------
    //Laurent Delrieu
    //18/12/2020
    //https://discourse.mcneel.com/t/c-welzls-minimum-bounding-sphere/109246/7

    // Use this one if you want to use Welzl method but beware there is a bug somewhere
    //Don't put more than 300 points
    //A = MinimumBoundingSphereWelzl.GetMinimumBoundingSphere(lst_points);
    //B = lst_points;
    List<Point3d> _boundary_points;
    Sphere _sphere = MinimumBoundingSphereIncrement.GetMinimumBoundingSphere(lst_points, out _boundary_points, 1000000, random);
    sphere = _sphere;
    radius = _sphere.Radius;
    center = _sphere.Center;
    boundary_points = _boundary_points;

    Sphere _new_sphere = Sphere5Points(_boundary_points);
    center2 = _new_sphere.Center;
    radius2 = _new_sphere.Radius;

    Component.Message = "Minimum Bounding Sphere";
# ---------- c_script: C# additional code ----------
  /// <summary>
  /// Class to calculate the minimum bounding sphere
  /// it takes the first and second points to make a sphere then add one point at each increment
  ///Laurent Delrieu, 18/12/2020
  /// </summary>
  public static class  MinimumBoundingSphereIncrement
  {
    //Tolerance to be inside the sphere
    static double epsilon = 1e-4;
    /// <summary>
    ///
    /// </summary>
    /// <param name="points">List of points</param>
    /// <param name="boundaryPoints">Points that are used to make the sphere</param>
    /// <param name="nMax">Max number of iterations, must be suppressed in future release</param>
    /// <returns>Minimum sphere</returns>
    public  static Sphere GetMinimumBoundingSphere(List<Point3d> points, out List<Point3d> boundaryPoints, int nMax, bool random)
    {
      Random rnd = new Random();
      boundaryPoints = new List<Point3d>();
      List<Point3d> allPoints = new List<Point3d>(points);

      Sphere sphere = Sphere.Unset;
      if (allPoints.Count == 1)
      {
        sphere = new Sphere(allPoints[0], 0);
        boundaryPoints.Add(allPoints[0]);
        allPoints.RemoveAt(0);
      }
      else if (points.Count > 1)
      {
        sphere = Sphere2Points(allPoints[0], allPoints[1]);
        boundaryPoints.Add(allPoints[0]);
        boundaryPoints.Add(allPoints[1]);

        allPoints.RemoveAt(1);
        allPoints.RemoveAt(0);
      }

      int count = 0;
      if (random)
      {
        while (allPoints.Count > 0 && count < nMax)
        {
          int next = rnd.Next(allPoints.Count);
          sphere = AddPoint(sphere, ref boundaryPoints, allPoints[next]);
          allPoints.RemoveAt(next);

          count++;
        }}
      else
      {

        while (allPoints.Count > 0 && count < nMax)
        {
          sphere = AddPoint(sphere, ref boundaryPoints, allPoints[0]);
          allPoints.RemoveAt(0);

          count++;
        }
      }
      return sphere;
    }

    /// <summary>
    /// Add a point to the minimum sphere and update boundary points
    /// </summary>
    /// <param name="initialSphere">Initial bounding sphere</param>
    /// <param name="boundaryPoints">List of boundary points as input and output</param>
    /// <param name="newPoint">New point to add</param>
    /// <returns>Updated or not minimum bounding sphere</returns>
    public static Sphere AddPoint(Sphere initialSphere, ref List<Point3d> boundaryPoints, Point3d newPoint)
    {
      //If new point is inside sphere
      Sphere output = initialSphere;
      //New Point is not on the sphere
      if (newPoint.DistanceTo(output.Center) > output.Radius)
      {
        // Print(" Ajout d'un point" + newPoint);
        boundaryPoints.Add(newPoint);
        output = Sphere5Points(boundaryPoints);

        for (int i = boundaryPoints.Count - 2; i >= 0; i--)
        {
          if (ContainsStrict(output, boundaryPoints[i], epsilon))
          {
            // Print(" Suppression : " + boundaryPoints[i]);
            boundaryPoints.RemoveAt(i);
          }
        }
        //Print(" Boundary cout = " + boundaryPoints.Count);
        if (boundaryPoints.Count >= 5)
        {
          boundaryPoints.RemoveAt(0);
        }
      }
      return output;
    }
  }



  /// <summary>
  /// Minimum bounding sphere of a maximum of 5 points
  /// </summary>
  /// <param name="lst_points">List of points, no more than 5 points</param>
  /// <returns>Bounding sphere</returns>
  public static Sphere Sphere5Points(List<Point3d> lst_points)
  {
    //Default output
    Sphere sphere = Sphere.Unset;
    //If there is 0, 1, 2 3 or 4 points
    if (lst_points.Count <= 4)
    {
      switch (lst_points.Count)
      {
        case 0: return Sphere.Unset;
        case 1: return new Sphere(lst_points[0], 0);
        case 2: return Sphere2Points(lst_points[0], lst_points[1]);
        case 3: return Sphere3Points(lst_points[0], lst_points[1], lst_points[2]);
        case 4: return Sphere4Points(lst_points[0], lst_points[1], lst_points[2], lst_points[3]);
      }
    }
    //All poissible spheres around the 4 among the 5 points
    Sphere sphere0 = Sphere4Points(lst_points[1], lst_points[2], lst_points[3], lst_points[4]);
    Sphere sphere1 = Sphere4Points(lst_points[0], lst_points[2], lst_points[3], lst_points[4]);
    Sphere sphere2 = Sphere4Points(lst_points[0], lst_points[1], lst_points[3], lst_points[4]);
    Sphere sphere3 = Sphere4Points(lst_points[0], lst_points[1], lst_points[2], lst_points[4]);
    Sphere sphere4 = Sphere4Points(lst_points[0], lst_points[1], lst_points[2], lst_points[3]);

    //Spheres that contains all 4 points
    List<Sphere> lst_spheres = new  List<Sphere>();
    if (Contains(sphere0, lst_points[0])) lst_spheres.Add(sphere0);
    if (Contains(sphere1, lst_points[1])) lst_spheres.Add(sphere1);
    if (Contains(sphere2, lst_points[2])) lst_spheres.Add(sphere2);
    if (Contains(sphere3, lst_points[3])) lst_spheres.Add(sphere3);
    if (Contains(sphere4, lst_points[4])) lst_spheres.Add(sphere4);

    //We keep the minimum sphere
    if (lst_spheres.Count > 0)
    {
      sphere = lst_spheres[0];
      for (int i = 1; i < lst_spheres.Count; i++)
      {
        if (lst_spheres[i].Radius < sphere.Radius)
        {
          sphere = lst_spheres[i];
        }
      }
    }
    return sphere;
  }




  /// <summary>
  /// Class to compute the minimum bounding sphere with Welzl method
  /// BEWARE if more than 300 points, there is a bug somewhere
  /// https://gamedev.stackexchange.com/questions/162731/welzl-algorithm-to-find-the-smallest-bounding-sphere
  /// </summary>
  public static class  MinimumBoundingSphereWelzl
  {
    public static List<Point3d> _boundaryPoints = null;
    static Random random = new Random();

    /// <summary>
    /// Main method to compute the Minimum Bounding Sphere using Welzl method
    /// </summary>
    /// <param name="points">List of points</param>
    /// <returns>Minimum Bounding Sphere</returns>
    public  static Sphere GetMinimumBoundingSphere(List<Point3d> points)
    {
      if (_boundaryPoints == null)
      {
        _boundaryPoints = new List<Point3d>(4);
      }
      else
      {
        _boundaryPoints.Clear();
      }
      return BallWithBounds(points);
    }

    /// <summary>
    /// Recursive method to calculate a minimum Bounding Sphere
    /// </summary>
    /// <param name="contained"></param>
    /// <returns></returns>
    private static Sphere BallWithBounds(List<Point3d> contained)
    {
      if (contained.Count == 0 || _boundaryPoints.Count == 4)
      {
        switch (_boundaryPoints.Count)
        {
          case 0: return Sphere.Unset;
          case 1: return new Sphere(_boundaryPoints[0], 0);
          case 2: return Sphere2Points(_boundaryPoints[0], _boundaryPoints[1]);
          case 3: return Sphere3Points(_boundaryPoints[0], _boundaryPoints[1], _boundaryPoints[2]);
          case 4: return Sphere4Points(_boundaryPoints[0], _boundaryPoints[1], _boundaryPoints[2], _boundaryPoints[3]);
        }
      }
      int last = contained.Count - 1;
      int removeAt = random.Next(0, contained.Count);

      Point3d removed = contained[removeAt];
      contained[removeAt] = contained[last];
      contained.RemoveAt(last);

      var ball = BallWithBounds(contained);

      if(!Contains(ball, removed))
      {
        _boundaryPoints.Add(removed);
        ball = BallWithBounds(contained);
        _boundaryPoints.RemoveAt(_boundaryPoints.Count - 1);
      }

      contained.Add(removed);
      return ball;
    }
  }

  /// <summary>
  /// Test if a point is strictly inside a sphere and not on the sphere
  /// </summary>
  /// <param name="sphere">Sphere</param>
  /// <param name="point">Point</param>
  /// <param name="epsilon">Precision or tolerance</param>
  /// <returns>Return true if point is inside</returns>
  public  static bool ContainsStrict(Sphere sphere, Point3d point, double epsilon)
  {
    bool output = false;

    if ((sphere.Radius - sphere.Center.DistanceTo(point)) >= epsilon)
    {
      output = true;
    }
    return output;
  }

  /// <summary>
  /// Return true if point is on or inside the sphere
  /// </summary>
  /// <param name="sphere">Sphere</param>
  /// <param name="point">Point</param>
  /// <returns>Return true if point is inside or on the sphere</returns>
  public  static bool Contains(Sphere sphere, Point3d point)
  {
    bool output = false;

    if (sphere.Center.DistanceTo(point) <= sphere.Radius)
    {
      output = true;
    }
    return output;
  }

  /// <summary>
  /// Minimum bounding sphere having 2 points
  /// </summary>
  /// <param name="a">First point</param>
  /// <param name="b">Second Point</param>
  /// <returns>Minimum bounding sphere</returns>
  public static Sphere Sphere2Points(Point3d a, Point3d b)
  {
    Sphere sphere = Sphere.Unset;
    double radius = a.DistanceTo(b) / 2.0;
    if (radius > 1e-30)
    {
      sphere = new Sphere((a + b) / 2.0, radius);
    }
    return  sphere;
  }

  /// <summary>
  ///  Minimum bounding sphere having 3 points
  /// </summary>
  /// <param name="a"></param>
  /// <param name="b"></param>
  /// <param name="c"></param>
  /// <returns>Minimum bounding sphere</returns>
  public static Sphere  Sphere3Points(Point3d a, Point3d b, Point3d c)
  {
    Sphere sphere3 = GetCircumSphere(a, b, c);

    Sphere sphere_ab = Sphere2Points(a, b);
    Sphere sphere_ac = Sphere2Points(a, c);
    Sphere sphere_bc = Sphere2Points(b, c);

    Sphere sphereOK = sphere3;
    if ((sphere_ab.IsValid) && sphere_ab.Center.DistanceTo(c) < sphereOK.Radius)
    {
      if ( sphere_ab.Radius < sphereOK.Radius)
      {
        sphereOK = sphere_ab;
      }
    }
    if ((sphere_ac.IsValid) && sphere_ac.Center.DistanceTo(b) < sphereOK.Radius)
    {
      if ( sphere_ac.Radius < sphereOK.Radius)
      {
        sphereOK = sphere_ac;
      }
    }
    if ((sphere_bc.IsValid) && sphere_bc.Center.DistanceTo(a) < sphereOK.Radius)
    {
      if ( sphere_bc.Radius < sphereOK.Radius)
      {
        sphereOK = sphere_bc;
      }
    }
    return sphereOK;
  }

  /// <summary>
  ///  Minimum bounding sphere having 4 points
  /// </summary>
  /// <param name="a"></param>
  /// <param name="b"></param>
  /// <param name="c"></param>
  /// <param name="d"></param>
  /// <returns>Minimum bounding sphere</returns>
  public static Sphere  Sphere4Points(Point3d a, Point3d b, Point3d c, Point3d d)
  {
    Sphere sphere4 = GetCircumSphere(a, b, c, d);

    Sphere sphere_abc = Sphere3Points(a, b, c);
    Sphere sphere_abd = Sphere3Points(a, b, d);
    Sphere sphere_acd = Sphere3Points(a, c, d);
    Sphere sphere_bcd = Sphere3Points(b, c, d);

    Sphere sphereOK = sphere4;

    if (sphere_abc.IsValid && sphere_abc.Center.DistanceTo(d) < sphereOK.Radius)
    {
      if ( sphere_abc.Radius < sphereOK.Radius)
      {
        sphereOK = sphere_abc;
      }
    }
    if (sphere_abd.IsValid && sphere_abd.Center.DistanceTo(c) < sphereOK.Radius)
    {
      if ( sphere_abd.Radius < sphereOK.Radius)
      {
        sphereOK = sphere_abd;
      }
    }
    if (sphere_acd.IsValid && sphere_acd.Center.DistanceTo(b) < sphereOK.Radius)
    {
      if ( sphere_acd.Radius < sphereOK.Radius)
      {
        sphereOK = sphere_acd;
      }
    }
    if (sphere_bcd.IsValid && sphere_bcd.Center.DistanceTo(a) < sphereOK.Radius)
    {
      if ( sphere_bcd.Radius < sphereOK.Radius)
      {
        sphereOK = sphere_bcd;
      }
    }
    return sphereOK;
  }
  /// <summary>
  ///Calculate the circumscribed sphere of 3 points, it is not the minimal bounding sphere
  /// https://gamedev.stackexchange.com/questions/60630/how-do-i-find-the-circumcenter-of-a-triangle-in-3d
  /// </summary>
  /// <param name="a">First point</param>
  /// <param name="b">Second point</param>
  /// <param name="c">Third point</param>
  /// <returns></returns>
  public static Sphere GetCircumSphere(Point3d a, Point3d b, Point3d c)
  {
    Vector3d ac = c - a;
    Vector3d ab = b - a;
    Vector3d abXac = Vector3d.CrossProduct(ab, ac);

    Sphere sphere = Sphere.Unset;
    if (abXac.Length > 1e-12)
    {
      // this is the vector from a TO the circumsphere center
      Vector3d toCircumsphereCenter = (Vector3d.CrossProduct(abXac, ab) * ac.SquareLength + Vector3d.CrossProduct(ac, abXac) * ab.SquareLength) / (2.0 * abXac.SquareLength);
      double circumsphereRadius = toCircumsphereCenter.Length;
      sphere = new Sphere(a + toCircumsphereCenter, circumsphereRadius);
    }
    else
    {
      Sphere sphere_ab = new Sphere((a + b) / 2.0, a.DistanceTo(b) / 2.0);
      Sphere sphere_ac = new Sphere((a + c) / 2.0, a.DistanceTo(c) / 2.0);
      Sphere sphere_bc = new Sphere((b + c) / 2.0, b.DistanceTo(c) / 2.0);
      sphere = sphere_ab;
      if (sphere_ac.Radius > sphere.Radius) sphere = sphere_ac;
      if (sphere_bc.Radius > sphere.Radius) sphere = sphere_bc;
    }
    return  sphere;
  }
  /// <summary>
  ///Calculate the circumscribed sphere of 4 points, it is not the minimal bounding sphere
  ///
  /// https://mathworld.wolfram.com/Circumsphere.html
  /// </summary>
  /// <param name="p1">First point</param>
  /// <param name="p2">Second Point</param>
  /// <param name="p3">Third Point</param>
  /// <param name="p4">Fourh Point</param>
  /// <returns>Minimum bounding sphere</returns>
  public static Sphere GetCircumSphere(Point3d p1, Point3d p2, Point3d p3, Point3d p4)
  {
    //TODO of point aligned or in a plane =>
    Sphere sphere = Sphere.Unset;

    Point3d center = Point3d.Origin;
    double radius = 1.0;


    //Matrix a = new Matrix(4, 4);
    Transform a = new Transform(1);
    //row colum,)
    a[0, 0] = p1.X;
    a[0, 1] = p1.Y;
    a[0, 2] = p1.Z;
    a[0, 3] = 1;

    a[1, 0] = p2.X;
    a[1, 1] = p2.Y;
    a[1, 2] = p2.Z;
    a[1, 3] = 1;

    a[2, 0] = p3.X;
    a[2, 1] = p3.Y;
    a[2, 2] = p3.Z;
    a[2, 3] = 1;

    a[3, 0] = p4.X;
    a[3, 1] = p4.Y;
    a[3, 2] = p4.Z;
    a[3, 3] = 1;

    //Matrix dx = new Matrix(4, 4);
    Transform dx = new Transform(1);
    dx[0, 0] = p1.X * p1.X + p1.Y * p1.Y + p1.Z * p1.Z;
    dx[0, 1] = p1.Y;
    dx[0, 2] = p1.Z;
    dx[0, 3] = 1;
    dx[1, 0] = p2.X * p2.X + p2.Y * p2.Y + p2.Z * p2.Z;
    dx[1, 1] = p2.Y;
    dx[1, 2] = p2.Z;
    dx[1, 3] = 1;
    dx[2, 0] = p3.X * p3.X + p3.Y * p3.Y + p3.Z * p3.Z;
    dx[2, 1] = p3.Y;
    dx[2, 2] = p3.Z;
    dx[2, 3] = 1;
    dx[3, 0] = p4.X * p4.X + p4.Y * p4.Y + p4.Z * p4.Z;
    dx[3, 1] = p4.Y;
    dx[3, 2] = p4.Z;
    dx[3, 3] = 1;
    Transform dy = new Transform(1);
    dy[0, 0] = p1.X * p1.X + p1.Y * p1.Y + p1.Z * p1.Z;
    dy[0, 1] = p1.X;
    dy[0, 2] = p1.Z;
    dy[0, 3] = 1;
    dy[1, 0] = p2.X * p2.X + p2.Y * p2.Y + p2.Z * p2.Z;
    dy[1, 1] = p2.X;
    dy[1, 2] = p2.Z;
    dy[1, 3] = 1;
    dy[2, 0] = p3.X * p3.X + p3.Y * p3.Y + p3.Z * p3.Z;
    dy[2, 1] = p3.X;
    dy[2, 2] = p3.Z;
    dy[2, 3] = 1;
    dy[3, 0] = p4.X * p4.X + p4.Y * p4.Y + p4.Z * p4.Z;
    dy[3, 1] = p4.X;
    dy[3, 2] = p4.Z;
    dy[3, 3] = 1;

    Transform dz = new Transform(1);
    dz[0, 0] = p1.X * p1.X + p1.Y * p1.Y + p1.Z * p1.Z;
    dz[0, 1] = p1.X;
    dz[0, 2] = p1.Y;
    dz[0, 3] = 1;
    dz[1, 0] = p2.X * p2.X + p2.Y * p2.Y + p2.Z * p2.Z;
    dz[1, 1] = p2.X;
    dz[1, 2] = p2.Y;
    dz[1, 3] = 1;
    dz[2, 0] = p3.X * p3.X + p3.Y * p3.Y + p3.Z * p3.Z;
    dz[2, 1] = p3.X;
    dz[2, 2] = p3.Y;
    dz[2, 3] = 1;
    dz[3, 0] = p4.X * p4.X + p4.Y * p4.Y + p4.Z * p4.Z;
    dz[3, 1] = p4.X;
    dz[3, 2] = p4.Y;
    dz[3, 3] = 1;

    Transform c = new Transform(1);
    c[0, 0] = p1.X * p1.X + p1.Y * p1.Y + p1.Z * p1.Z;
    c[0, 1] = p1.X;
    c[0, 2] = p1.Y;
    c[0, 3] = p1.Z;
    c[1, 0] = p2.X * p2.X + p2.Y * p2.Y + p2.Z * p2.Z;
    c[1, 1] = p2.X;
    c[1, 2] = p2.Y;
    c[1, 3] = p2.Z;
    c[2, 0] = p3.X * p3.X + p3.Y * p3.Y + p3.Z * p3.Z;
    c[2, 1] = p3.X;
    c[2, 2] = p3.Y;
    c[2, 3] = p3.Z;
    c[3, 0] = p4.X * p4.X + p4.Y * p4.Y + p4.Z * p4.Z;
    c[3, 1] = p4.X;
    c[3, 2] = p4.Y;
    c[3, 3] = p4.Z;
    center = new Point3d(dx.Determinant / (2 * a.Determinant), -dy.Determinant / (2.0 * a.Determinant), dz.Determinant / (2.0 * a.Determinant));
    double dx2 = dx.Determinant * dx.Determinant;
    double dy2 = dy.Determinant * dy.Determinant;
    double dz2 = dz.Determinant * dz.Determinant;
    double ac = a.Determinant * c.Determinant;
    radius = Math.Sqrt(dx2 + dy2 + dz2 - 4.0 * ac) / (2.0 * Math.Abs(a.Determinant));

    return new Sphere(center, radius);
  }
# ---------- end c_script ----------
circle_cnr = CircleCNR(Center=c_script.center, Normal=Vector(0, 0, 1), Radius=c_script.radius)
merge = Merge(Data1=simplify(bounding_rectangle_4.Bounding), Data2=circle_cnr)
area = Area(Geometry=merge)  # -> Area, Centroid
null_item_5 = NullItem(Item=area.Area)  # -> NullFlags, InvalidFlags, Description
cull_pattern_13 = CullPattern(List=merge, CullPattern=invert(null_item_5.NullFlags))
cull_pattern_14 = CullPattern(List=area.Area, CullPattern=invert(null_item_5.NullFlags))
sort_list = SortList(Keys=cull_pattern_14, ValuesValuesA=cull_pattern_13)  # -> Keys, ValuesValuesA
list_item_2 = ListItem(List=sort_list.ValuesValuesA, Index=0, Wrap=True)

addition_2 = Addition(A=list_length_3, B="0")
bounding_rectangle_5 = BoundingRectangle(Geometry=simplify(cull_pattern_11), Plane=plane_2, Axis=0, Slide=0, Union=True)  # -> Bounding, DimensionX, DimensionY
boolean_2 = Boolean(addition_2)
curve_3 = Curve([bounding_rectangle_5.Bounding, bounding_rectangle_2.Bounding, bounding_rectangle_3.Bounding])
null_item_6 = NullItem(Item=curve_3)  # -> NullFlags, InvalidFlags, Description

# ---- group: Grids
element_view_geometry_3 = ElementViewGeometry(Elements=query_elements_2.Elements, View=view)  # -> flatten(Elements), flatten(Geometry), Categories

# ----
cull_pattern_15 = CullPattern(List=curve_3, CullPattern=invert(null_item_6.InvalidFlags))  # -> simplify(flatten(List))
element_location = ElementLocation(Element=query_elements_3.Elements)  # -> Element, Location, Hand, Facing, WorkPlane
bounding_rectangle_6 = BoundingRectangle(
    Geometry=simplify(graft(query_elements_3.Elements)),
    Plane=simplify(graft(element_location.Location)),
    Axis=0,
    Slide=0,
    Union=True)  # -> flatten(Bounding), DimensionX, DimensionY
offset_curve = OffsetCurve(Curve=bounding_rectangle_6.Bounding, Distance=Slider(100, range=0..100), Corners=1)

# ---- group: Offset and bool union to simplify calc.
project_2 = Project(Geometry=list_item_2, Plane=plane_2)  # -> flatten(Geometry), Transform
region_union = RegionUnion(Curves=flatten(cull_pattern_15), Plane=plane_2)
offset_curve_2 = OffsetCurve(
    Curve=[project_2.Geometry, region_union],
    Plane=plane_2,
    Distance=Slider(50, range=0..1000),
    BothSides=0,
    Kinks=0,
    CapType=1)  # -> flatten(Offset)
region_union_2 = RegionUnion(Curves=offset_curve_2, Plane=plane_2)  # -> simplify(Result)

# ---- group: Where not to place tag
project_3 = Project(Geometry=[offset_curve, region_union_2], Plane=plane_2)  # -> Geometry, Transform

# ---- group: Wall Tags
annotation_references_3 = AnnotationReferences(Annotation=simplify(cull_pattern_6))  # -> simplify(References)
element_location_2 = ElementLocation(Element=annotation_references_3)  # -> Element, Location, Hand, Facing, WorkPlane
bounding_rectangle_7 = BoundingRectangle(Geometry=simplify(graft(annotation_references_3)), Plane=element_location_2.WorkPlane, Axis=0, Slide=0, Union=True)  # -> simplify(Bounding), simplify(DimensionX), simplify(DimensionY)
offset_curve_3 = OffsetCurve(Curve=bounding_rectangle_7.Bounding, Distance="1000", Plane=element_location_2.Location, Corners=1)  # -> simplify(Curve)

# ----
element_curve = ElementCurve(Element=annotation_references_3)  # -> Element, Curve

# ---- group: Adjoustin domains
deconstruct_box = DeconstructBox(Box=offset_curve_3)  # -> Plane, X, Y, Z
deconstruct_box_2 = DeconstructBox(Box=bounding_rectangle_7.Bounding)  # -> Plane, X, Y, Z
deconstruct_domain = DeconstructDomain(Domain=deconstruct_box.X)  # -> Start, End
deconstruct_domain_2 = DeconstructDomain(Domain=deconstruct_box.Y)  # -> Start, End
deconstruct_domain_3 = DeconstructDomain(Domain=deconstruct_box.X)  # -> Start, End
deconstruct_domain_4 = DeconstructDomain(Domain=deconstruct_box.Y)  # -> Start, End
subtraction = Subtraction(A=deconstruct_domain.End, B=deconstruct_domain.Start)
subtraction_2 = Subtraction(A=deconstruct_domain_2.End, B=deconstruct_domain_2.Start)
subtraction_3 = Subtraction(A=deconstruct_domain_3.End, B=deconstruct_domain_3.Start)
subtraction_4 = Subtraction(A=deconstruct_domain_4.End, B=deconstruct_domain_4.Start)
smaller_than = SmallerThan(FirstNumber=subtraction, SecondNumber=subtraction_2)  # -> SmallerThan, OrEqualTo
smaller_than_2 = SmallerThan(FirstNumber=subtraction_3, SecondNumber=subtraction_4)  # -> SmallerThan, OrEqualTo
cull_pattern_16 = CullPattern(List=subtraction_2, CullPattern=invert(smaller_than.SmallerThan))
cull_pattern_17 = CullPattern(List=subtraction, CullPattern=smaller_than.SmallerThan)
cull_pattern_18 = CullPattern(List=subtraction_3, CullPattern=invert(smaller_than_2.SmallerThan))
cull_pattern_19 = CullPattern(List=subtraction_4, CullPattern=smaller_than_2.SmallerThan)
number = Number([cull_pattern_17, cull_pattern_16])
number_2 = Number([cull_pattern_18, cull_pattern_19])
multiplication = Multiplication(A="1000", B="2")
subtraction_5 = Subtraction(A=number_2, B=multiplication)
division = Division(A=number, B="2")
negative = Negative(Value=division)
division_2 = Division(A=subtraction_5, B="2")
negative_2 = Negative(Value=division_2)
construct_domain = ConstructDomain(DomainStart=negative, DomainEnd=division)
construct_domain_2 = ConstructDomain(DomainStart=negative_2, DomainEnd=division_2)
rectangle = Rectangle(Plane=element_location_2.Location, XSize=construct_domain_2, YSize=construct_domain, Radius=0)  # -> Rectangle, Length

# ----
stream_filter_2 = StreamFilter(Gate=boolean_2, Stream1=rectangle.Rectangle)

# ---- group: Wall Tags (continued)
curve_4 = Curve([stream_filter_2, stream_filter])

# ---- group: Check if elements are inside crv?
length = Length(Curve=curve_4)
sort_list_2 = SortList(Keys=length, ValuesValuesA=curve_4)  # -> Keys, reverse(ValuesValuesA)
list_item_3 = ListItem(List=sort_list_2.ValuesValuesA, Index=0, Wrap=True)
curve_5 = Curve(list_item_3)

# ---- group: Possible area to place tag
project_4 = Project(Geometry=curve_5, Plane=plane_2)  # -> Geometry, Transform
boundary_surfaces = BoundarySurfaces(Edges=project_4.Geometry)

# ----
boundary_surfaces_2 = BoundarySurfaces(Edges=project_3.Geometry)  # -> flatten(Surfaces)
line_2 = Line(element_view_geometry_3.Elements)
collision_one_many = CollisionOneMany(Collider=boundary_surfaces_2, Obstacles=boundary_surfaces)  # -> Collision, Index
cull_pattern_20 = CullPattern(List=boundary_surfaces_2, CullPattern=collision_one_many.Collision)
plane_3 = Plane(plane_2)

curve_6 = Curve(boundary_surfaces)
curve_7 = Curve(cull_pattern_20)
clean_tree = CleanTree(RemoveNulls=True, RemoveInvalid=True, RemoveEmpty=True, Tree=curve_7)

# ---- group: Intersection and creation of surface
region_difference = RegionDifference(CurvesA=curve_6, CurvesB=clean_tree, Plane=plane_3)
clean_tree_2 = CleanTree(RemoveNulls=True, RemoveInvalid=True, RemoveEmpty=True, Tree=region_difference)
boundary_surfaces_3 = BoundarySurfaces(Edges=clean_tree_2)  # -> simplify(Surfaces)
project_5 = Project(Geometry=boundary_surfaces_3, Plane=plane_2)  # -> Geometry, Transform

# ---- group: Largest fragment
project_6 = Project(Geometry=line_2, Plane=plane_2)  # -> Geometry, Transform

# ---- group: Largest fragment / Slice with grid
surface_split = SurfaceSplit(Surface=project_5.Geometry, Curves=project_6.Geometry)  # -> simplify(Fragments)
path_mapper = PathMapper(surface_split, source="{A;B}", target="{A}")

# ---- group: Largest fragment (continued)
surface = Surface(path_mapper)
surface_2 = Surface(surface)
area_2 = Area(Geometry=surface_2)  # -> Area, Centroid
sort_list_3 = SortList(Keys=area_2.Area, ValuesValuesA=surface_2)  # -> Keys, reverse(ValuesValuesA)
list_item_4 = ListItem(List=sort_list_3.ValuesValuesA, Index=0, Wrap=True)

# ----
area_3 = Area(Geometry=list_item_4)  # -> Area, Centroid
smaller_than_3 = SmallerThan(FirstNumber=area_3.Area, SecondNumber=power_of_10)  # -> SmallerThan, OrEqualTo
cull_pattern_21 = CullPattern(List=list_item_4, CullPattern=invert(smaller_than_3.SmallerThan))

# ---- group: Point of mesh furthest from edge
panel_2 = Panel("250")

# ---- group: Point of mesh furthest from edge / Find point of mesh furthest from edge
cluster = Cluster(brep=flatten(cull_pattern_21), max_edge=panel_2)

# ---- group: Point of mesh furthest from edge (continued)
point = Point(flatten(cluster))
surface_closest_point = SurfaceClosestPoint(Point=point, Surface=cull_pattern_21)  # -> Point, UVPoint, Distance
boolean_3 = Boolean(surface_closest_point.Distance)

# ----
cull_pattern_22 = CullPattern(List=surface_closest_point.Point, CullPattern=invert(boolean_3))
graphical_element_2 = GraphicalElement(query_view_elements)

clean_tree_3 = CleanTree(RemoveNulls=True, RemoveInvalid=True, RemoveEmpty=True, Tree=cull_pattern_22)

list_item_5 = ListItem(List=clean_tree_3, Index=0, Wrap=True)
tree_statistics = TreeStatistics(Tree=list_item_5)  # -> Paths, Length, Count
tree_branch = TreeBranch(Tree=simplify(graft(graphical_element_2)), Path=tree_statistics.Paths, MaintainPaths=True)

element_location_3 = ElementLocation(Element=simplify(tree_branch), Location=list_item_5)  # -> Element, Location, Hand, Facing, WorkPlane
bounding_rectangle_8 = BoundingRectangle(Geometry=element_location_3.Element, Plane=PlaneXY(0, 0, 0), Axis=0, Slide=0, Union=True)  # -> Bounding, DimensionX, DimensionY
area_4 = Area(Geometry=bounding_rectangle_8.Bounding)  # -> Area, Centroid
point_2 = Point(element_location_3.Location)
vector_2pt = Vector2Pt(PointA=point_2, PointB=area_4.Centroid, Unitize=False)  # -> simplify(Vector), Length
negative_3 = Negative(Value=vector_2pt.Vector)
move = Move(Geometry=element_location_3.Location, Motion=negative_3)  # -> Geometry, Transform
element_location_4 = ElementLocation(Element=simplify(element_location_3.Element), Location=move.Geometry)  # -> Element, Location, Hand, Facing, WorkPlane

# ==== cluster Cluster
max_edge = ClusterInput()
settings_custom = SettingsCustom(
    StitchSeams=True,
    SimplePlanes=Toggle(False),
    Refine=True,
    MinCount=16,
    MaxCount=400,
    AspectRatio=20,
    MaxDistance=0,
    MaxAngle=20,
    MinEdge=0,
    MaxEdge=max_edge)
brep = ClusterInput()
mesh_brep = MeshBrep(Brep=brep, Settings=settings_custom)
deconstruct_mesh = DeconstructMesh(Mesh=mesh_brep)  # -> simplify(Vertices), Faces, Colours, Normals
mesh_edges = MeshEdges(Mesh=mesh_brep)  # -> NakedEdges, InteriorEdges, NonManifoldEdges
join_curves = JoinCurves(Curves=mesh_edges.NakedEdges, Preserve=False)  # -> simplify(Curves)
curve_closest_point = CurveClosestPoint(Point=simplify(graft(deconstruct_mesh.Vertices)), Curve=simplify(flatten(join_curves)))  # -> Point, Parameter, Distance
sort_list = SortList(Keys=curve_closest_point.Distance, ValuesValuesA=curve_closest_point.Point)  # -> Keys, ValuesValuesA
list_item = ListItem(List=sort_list.ValuesValuesA, Index=0, Wrap=True)
data = Data(simplify(graft(deconstruct_mesh.Vertices)))
line = Line(StartPoint=data, EndPoint=list_item)
path_mapper = PathMapper(data, source="{A;B}", target="{A}")
path_mapper_2 = PathMapper(line, source="{A;B}", target="{A}")
data_2 = Data(path_mapper)
data_3 = Data(path_mapper_2)
length = Length(Curve=data_3)
sort_list_2 = SortList(Keys=length, ValuesValuesA=data_2)  # -> Keys, reverse(ValuesValuesA)
list_item_2 = ListItem(List=sort_list_2.ValuesValuesA, Index=0, Wrap=True)
i = ClusterOutput(list_item_2)
